# Grasshopper definition Llama_Layouts_Basic.gh (Grasshopper 1.0.7)
# plug-ins: Telepathy, ifLabLlamaTools

panel = Panel("""Title

Description



© if\LAB 2019-2021""")

# ---- group: DAVE
data = Data(0)

# ---- group: Inputs/Outputs
# Component Category Key
# Inputs/Outputs
# Users
data_2 = Data(0)

# ---- group: PAT
data_3 = Data(0)

# ---- group: Check for Issues
data_4 = Data(0)

# ---- group: DAN
data_5 = Data(0)

# ---- group: Create Layouts
layoutnames = ValueList({"temp", "37", "38", "39", "40", "41", "42", "43", "1", "2"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}, selected="temp")
displaymodes = ValueList({"Wireframe", "Shaded", "Rendered", "Ghosted", "X-Ray", "Technical", "Artistic", "Pen", "Arctic", "Raytraced", "Arctic w Materials", "BackFace_Shaded", "New Arctic_With Lines", "Shaded White"}, selected="Shaded")
layoutnames_2 = RemoteReceiver()
detailfocuspoint = RemoteReceiver()
detail_name = Panel("name")
# Layouts
button = Button()
panel_3 = Panel(layoutnames_2)
create_layouts = CreateLayouts(
    Run=button,
    LayoutNames=layoutnames_2,
    TemplateLayouts=layoutnames,
    DetailName=detail_name,
    DisplayMode=displaymodes,
    TargetPoints=detailfocuspoint,
    Scale="50")

# ---- group: Edit Details
localplanpoint = RemoteReceiver()
displaymodes_2 = ValueList({"Wireframe", "Shaded", "Rendered", "Ghosted", "X-Ray", "Technical", "Artistic", "Pen", "Arctic", "Raytraced", "Arctic w Materials", "BackFace_Shaded", "New Arctic_With Lines", "Shaded White"}, selected="Shaded")
pt = Point(localplanpoint)
column_naming = RemoteReceiver()
detail_name_2 = Panel("plan")
avr = Average(Input=pt)  # -> flatten(ArithmeticMean)
update_details = UpdateDetailsOnLayouts(
    RunFunction=Button(),
    LayoutNames=graft(column_naming),
    DetailNames=detail_name_2,
    DisplayMode=displaymodes_2,
    Target=graft(avr),
    Scale=Slider(10, range=0..10))

# ---- group: Run Layouts
edit_text = RemoteSender(Button())

# ---- group: Edit Text
panel_4 = Panel("""Drawn
Rev Date
Address
Project
Client_txt
Rev Name""")
layoutnames_3 = RemoteReceiver()
column_naming_2 = RemoteReceiver()
panel_5 = Panel("""DS
09/02/2022
LOT 204 (#12) WUNDERLICH ROAD, SUBIACO
ELEMENT 27 -III
SENTINEL
Design Documentation""")
c_script = CSharpScript(x=layoutnames_3)  # -> out, A; inputs x: String
# ---------- c_script: C# ----------
    A = x.PadLeft(3, '0');
# ---------- end c_script ----------
column_naming_3 = RemoteReceiver()
column_naming_4 = RemoteReceiver()
column_naming_5 = RemoteReceiver()
edit_text_2 = RemoteReceiver(edit_text)
edit_text_3 = RemoteReceiver(edit_text)
edit_text_4 = RemoteReceiver(edit_text)
format = Format(Format="Column {0} Brick Layout", Culture=127, Data0=column_naming_2)
format_2 = Format(Format="ART.{0}", Culture=127, Data0=c_script.A)
update_text_on_layouts = UpdateTextOnLayouts(Run=edit_text_2, LayoutNames=graft(column_naming_3), TextName="Drawing", TextValues=graft(format))
update_text_on_layouts_2 = UpdateTextOnLayouts(Run=edit_text_3, LayoutNames=graft(column_naming_4), TextName=panel_4, TextValues=panel_5)
update_text_on_layouts_3 = UpdateTextOnLayouts(Run=edit_text_4, LayoutNames=graft(column_naming_5), TextName="Drawing No", TextValues=graft(format_2))
panel_6 = Panel(format)

# ---- group: Export Layouts
output_path = Panel("C:\Users\david\Dropbox\!Maker + ifLAB - ARTWORKS\21_02_FINE_CHINA_SUBIACO_SENTINEL_GROUP\03_MODEL\00_Test_PDF_For_Review\2022-02-10")
print_to_pdf = PrintToPdf(Run=Button(), FolderLocation=output_path, ExcludeInclude=Toggle(True), Layouts="temp", Combinded=Toggle(False))

# ---- group: Delete Layouts
layouts = ValueList({"temp"}, selected="temp")
delete_layout = DeleteLayout(ExceptLayouts=layouts, DeleteAll=Button())
