# Grasshopper definition Qgis to Rhino Massing_TM fing around.gh (Grasshopper 1.0.7)
# plug-ins: Human, atit, Ironbug.LBHB_Legacy, Telepathy, Pufferfish, EleFront, Heteroptera, MetaHopper, Wombat

# Title
# 
# Description
# 
# https://www.intensivefieldslab.com/
# 
# © if\LAB 2019-2022
panel = Panel("")

# ---- group: Inputs/Outputs
# Component Category Key
# Inputs/Outputs
# Users
data = Data(0)

# ---- group: Standard
data_2 = Data(0)

# ---- group: Check for Issues
data_3 = Data(0)

# ----
unit_warning = UnitWarning(UnitSystem=4)

# ----
# 1) Input Directory Path
panel_2 = Panel("D:\Dropbox\if_LAB Projects\2202_UPDA House\02_SITE\0203_GIS\vectors")
filepath = RemoteSender(panel_2)

# ---- group: Selects Cadastre
filepath_2 = RemoteReceiver(filepath)
dir = DirectoryContents(FolderPath=filepath_2, Filter="*.shp", IncludeSubfolders=False)  # -> FilePaths, FileNames
tmatch = MatchText(Text=dir.FileNames, Pattern="*Cadastre*", Case=False)
dispatch = Dispatch(List=dir.FilePaths, DispatchPattern=tmatch)  # -> ListA, ListB
lng = ListLength(List=dispatch.ListA)
filter = StreamFilter(Gate=lng, Stream1=dispatch.ListA)
cadastreshp = RemoteSender(dispatch.ListA)

# ---- group: Select Contour Shape File
filepath_3 = RemoteReceiver(filepath)
dir_2 = DirectoryContents(FolderPath=filepath_3, Filter="*.shp", IncludeSubfolders=False)  # -> FilePaths, FileNames
tmatch_2 = MatchText(Text=dir_2.FileNames, Pattern="*Contour*", Case=True)
dispatch_2 = Dispatch(List=dir_2.FilePaths, DispatchPattern=tmatch_2)  # -> ListA, ListB
lng_2 = ListLength(List=dispatch_2.ListA)
panel_3 = Panel(dispatch_2.ListA)
filter_2 = StreamFilter(Gate=lng_2, Stream1=dispatch_2.ListA)
contourshp = RemoteSender(filter_2)

# ---- group: Select Buildings
filepath_4 = RemoteReceiver(filepath)
dir_3 = DirectoryContents(FolderPath=filepath_4, Filter="*.shp", IncludeSubfolders=False)  # -> FilePaths, FileNames
list = ItemSelector(
    dir_3.FileNames,
    {"clip_CadastrePolygonsLGATE_082_1", "clip_CadastrePolygonsLGATE_082_2", "clip_Contours_2m_250K_Perth_npj", "clip_MediumScaleTopoWaterPolygonLGATE_016", "clip_Native_Veg_Extent_DPIRD_005_WA_GDA2020_Public_Shapefile Native_Veg_Extent_DPIRD_005", "clip_RoadHierarchyMRWA_515"}, selected="clip_CadastrePolygonsLGATE_082_1")
tmatch_3 = MatchText(Text=dir_3.FileNames, Pattern="*Building*", Case=True)
dispatch_3 = Dispatch(List=dir_3.FilePaths, DispatchPattern=tmatch_3)  # -> ListA, ListB
lng_3 = ListLength(List=dispatch_3.ListA)
filter_3 = StreamFilter(Gate=lng_3, Stream1=dispatch_3.ListA)
ifilter = FilterByItem(GuideList=dir_3.FileNames, SelectedItems=list, List0=dir_3.FilePaths, invert=False)
buildingshp = RemoteSender(filter_3)

# ---- group: Selects Roads
filepath_5 = RemoteReceiver(filepath)
dir_4 = DirectoryContents(FolderPath=filepath_5, Filter="*.shp", IncludeSubfolders=False)  # -> FilePaths, FileNames
tmatch_4 = MatchText(Text=dir_4.FileNames, Pattern="*Road*", Case=True)
dispatch_4 = Dispatch(List=dir_4.FilePaths, DispatchPattern=tmatch_4)  # -> ListA, ListB
lng_4 = ListLength(List=dispatch_4.ListA)
filter_4 = StreamFilter(Gate=lng_4, Stream1=dispatch_4.ListA)
roadsshp = RemoteSender(filter_4)

# ---- group: Select Cropping Shape File
# 2) Set Files for each Type
filepath_6 = RemoteReceiver(filepath)
dir_5 = DirectoryContents(FolderPath=filepath_6, Filter="*.shp", IncludeSubfolders=False)  # -> FilePaths, FileNames
tmatch_5 = MatchText(Text=dir_5.FileNames, Pattern="*cropping*", Case=True)
dispatch_5 = Dispatch(List=dir_5.FilePaths, DispatchPattern=tmatch_5)  # -> ListA, ListB
lng_5 = ListLength(List=dispatch_5.ListA)
panel_4 = Panel(dispatch_5.ListA)
filter_5 = StreamFilter(Gate=lng_5, Stream1=dispatch_5.ListA)
croppingshp = RemoteSender(filter_5)

# ---- group: Select PublicTransLines
filepath_7 = RemoteReceiver(filepath)
dir_6 = DirectoryContents(FolderPath=filepath_7, Filter="*.shp", IncludeSubfolders=False)  # -> FilePaths, FileNames
tmatch_6 = MatchText(Text=dir_6.FileNames, Pattern="*Services*", Case=True)
dispatch_6 = Dispatch(List=dir_6.FilePaths, DispatchPattern=tmatch_6)  # -> ListA, ListB
lng_6 = ListLength(List=dispatch_6.ListA)
filter_6 = StreamFilter(Gate=lng_6, Stream1=dispatch_6.ListA)
publictranslinesshp = RemoteSender(filter_6)

# ---- group: Select PublicTransStops
filepath_8 = RemoteReceiver(filepath)
dir_7 = DirectoryContents(FolderPath=filepath_8, Filter="*.shp", IncludeSubfolders=False)  # -> FilePaths, FileNames
tmatch_7 = MatchText(Text=dir_7.FileNames, Pattern="*Stops*", Case=True)
dispatch_7 = Dispatch(List=dir_7.FilePaths, DispatchPattern=tmatch_7)  # -> ListA, ListB
lng_7 = ListLength(List=dispatch_7.ListA)
filter_7 = StreamFilter(Gate=lng_7, Stream1=dispatch_7.ListA)
publictransstopsshp = RemoteSender(filter_7)

# ----
# 3) Get All Data
toggle = FalseStartToggle(True)
getall = RemoteSender(toggle)

# ---- group: Bake Geo
# 4) Bake Geo
button = Button()
bake_all = RemoteSender(button)
onoff = EnableDisableObject(Enabled=button, AllObjects_Object=[pullcurvetomesh, roads_2, topmesh_3, join, crv_2, mesh_3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])

# ----
croppingshp_2 = RemoteReceiver(croppingshp)
wgs84 = RemoteSender(Toggle(True))

toggle_2 = FalseStartToggle(False)
toggle_3 = FalseStartToggle(False)

toggle_4 = FalseStartToggle(False)
getall_2 = RemoteReceiver(getall)
or = GateOr(A=getall_2, B=toggle_4)

toggle_5 = FalseStartToggle(False)
getall_3 = RemoteReceiver(getall)
or_2 = GateOr(A=getall_3, B=toggle_5)

toggle_6 = FalseStartToggle(False)
getall_4 = RemoteReceiver(getall)
or_3 = GateOr(A=getall_4, B=toggle_6)

wgs84_2 = RemoteReceiver(wgs84)

toggle_7 = FalseStartToggle(False)
toggle_8 = FalseStartToggle(False)

toggle_9 = FalseStartToggle(False)
getall_5 = RemoteReceiver(getall)
or_4 = GateOr(A=getall_5, B=toggle_9)

contourshp_2 = RemoteReceiver(contourshp)

# ---- group: Cropping Layer if needed
toggle_10 = FalseStartToggle(False)
path = FilePath(croppingshp_2)
imp_it = ImpIt(ShapefileShpPath=path, Project2WGS84=False, TrueOrFalse=toggle_10)  # -> Shapes, Features
toggle_11 = FalseStartToggle(False)
datavis_it = DataVisIt(Shapes=imp_it.Shapes, GetValueofFeature=imp_it.Features, TrueOrFalse=toggle_11)  # -> Polygon, Polyline, Point, AttValues

# ---- group: Buildings
getall_6 = RemoteReceiver(getall)
buildingshp_2 = RemoteReceiver(buildingshp)
or_5 = GateOr(A=getall_6, B=toggle_7)
imp_it_2 = ImpIt(ShapefileShpPath=buildingshp_2, Project2WGS84=False, TrueOrFalse=or_5)  # -> Shapes, Features
tmatch_8 = MatchText(Text=imp_it_2.Features, Pattern="height", Case=True)
getall_7 = RemoteReceiver(getall)
dispatch_8 = Dispatch(List=imp_it_2.Features, DispatchPattern=tmatch_8)  # -> ListA, ListB
or_6 = GateOr(A=getall_7, B=toggle_8)
panel_5 = Panel(dispatch_8.ListA)
datavis_it_2 = DataVisIt(Shapes=imp_it_2.Shapes, GetValueofFeature=dispatch_8.ListA, TrueOrFalse=or_6)  # -> Polygon, Polyline, Point, AttValues

# ---- group: Topo
getall_8 = RemoteReceiver(getall)
or_7 = GateOr(A=getall_8, B=toggle_2)
imp_it_3 = ImpIt(ShapefileShpPath=contourshp_2, Project2WGS84=wgs84_2, TrueOrFalse=or_7)  # -> Shapes, Features
tmatch_9 = MatchText(Text=imp_it_3.Features, Pattern="*elevation*", Case=False)
getall_9 = RemoteReceiver(getall)
or_8 = GateOr(A=getall_9, B=toggle_3)
dispatch_9 = Dispatch(List=imp_it_3.Features, DispatchPattern=tmatch_9)  # -> ListA, ListB
datavis_it_3 = DataVisIt(Shapes=imp_it_3.Shapes, GetValueofFeature=dispatch_9.ListA, TrueOrFalse=or_8)  # -> Polygon, Polyline, Point, AttValues
panel_6 = Panel(dispatch_9.ListA)

# ---- group: Roads
roadsshp_2 = RemoteReceiver(roadsshp)
imp_it_4 = ImpIt(ShapefileShpPath=roadsshp_2, Project2WGS84=False, TrueOrFalse=or)  # -> Shapes, Features
datavis_it_4 = DataVisIt(Shapes=imp_it_4.Shapes, GetValueofFeature=imp_it_4.Features, TrueOrFalse=or)  # -> Polygon, Polyline, Point, AttValues

# ----
# Cadastre
cadastreshp_2 = RemoteReceiver(cadastreshp)
imp_it_5 = ImpIt(ShapefileShpPath=cadastreshp_2, Project2WGS84=False, TrueOrFalse=or_3)  # -> Shapes, Features
panel_7 = Panel(imp_it_5.Features)
datavis_it_5 = DataVisIt(Shapes=imp_it_5.Shapes, GetValueofFeature=imp_it_5.Features, TrueOrFalse=or_3)  # -> Polygon, Polyline, Point, AttValues

# ---- group: Train Lines
# Public Transport Stops
publictransstopsshp_2 = RemoteReceiver(publictransstopsshp)
imp_it_6 = ImpIt(ShapefileShpPath=publictransstopsshp_2, Project2WGS84=False, TrueOrFalse=or_2)  # -> Shapes, Features
panel_8 = Panel(imp_it_6.Features)
datavis_it_6 = DataVisIt(Shapes=imp_it_6.Shapes, GetValueofFeature=imp_it_6.Features, TrueOrFalse=or_2)  # -> Polygon, Polyline, Point, AttValues

# Public Transport Lines
publictranslinesshp_2 = RemoteReceiver(publictranslinesshp)
imp_it_7 = ImpIt(ShapefileShpPath=publictranslinesshp_2, Project2WGS84=False, TrueOrFalse=or_4)  # -> Shapes, Features
datavis_it_7 = DataVisIt(Shapes=imp_it_7.Shapes, GetValueofFeature=imp_it_7.Features, TrueOrFalse=or_4)  # -> Polygon, Polyline, Point, AttValues
panel_9 = Panel(imp_it_7.Features)

# ----
scale = RemoteSender(Slider(100000, range=0..100000))

tmatch_10 = MatchText(Text=imp_it_5.Features, Pattern="land_type", Case=True)
python = GhPythonScript(x=tmatch_10)  # -> out, a; inputs x: list
# ---------- python: Python ----------
__author__ = "david"
__version__ = "2022.01.10"

import rhinoscriptsyntax as rs

list = []

for i in range(len(x)):
    if x[i]:
        list.append(i)
  
a = list
# ---------- end python ----------

scale_2 = RemoteReceiver(scale)
scale_nu = ScaleNU(Geometry=datavis_it_3.Polyline, Plane=PlaneXY(0, 0, 0), ScaleX=scale_2, ScaleY=scale_2, ScaleZ=1)  # -> Geometry, Transform

abs = Absolute(Value=datavis_it_2.AttValues)
equals = Equality(FirstNumber=abs, SecondNumber="99")  # -> Equality, Inequality
dispatch_10 = Dispatch(List=abs, DispatchPattern=equals.Equality)  # -> ListA, ListB
lng_8 = ListLength(List=dispatch_10.ListA)
dup = DuplicateData(Data="5", Number=lng_8, Order=True)
merge = Merge(Data1=simplify(dup), Data2=simplify(dispatch_10.ListB))

scale_3 = RemoteReceiver(scale)
scale_4 = RemoteReceiver(scale)

# ---- group: Move Back to Origin to remove meshing errors based on CRS
bbox = BoundingBox(Content=flatten(scale_nu.Geometry), Plane=PlaneXY(0, 0, 0), UnionBox=True)  # -> Box, Box_2
debrep = DeconstructBrep(Brep=bbox.Box)  # -> Faces, Edges, Vertices
center = Center(Geometry=debrep.Faces)  # -> Center, Dimension
pdecon = Deconstruct(Point=center.Center)  # -> XComponent, YComponent, ZComponent
sort = SortList(Keys=pdecon.ZComponent, ValuesA=center.Center)  # -> Keys, ValuesA
pt = ConstructPoint(XCoordinate=0, YCoordinate=0, ZCoordinate=0)
item = ListItem(List=sort.ValuesA, Index=0, Wrap=True)
orient = Orient(Source=item, Target=pt)  # -> Geometry, Transform
transform = RemoteSender(orient.Transform)

# ----
transform_2 = RemoteReceiver(transform)
transform_3 = Transform(Geometry=datavis_it.Polygon, Transform=transform_2)
disc = Discontinuity(Curve=transform_3, Level=1)  # -> Points, Parameters
pt_2 = Point(disc.Points)

transform_4 = RemoteReceiver(transform)
item_2 = ListItem(List=transform_4, Index=0, Wrap=True)  # -> Item, Item1
transform_5 = Transform(Geometry=datavis_it_6.Point, Transform=item_2.Item)
transform_6 = Transform(Geometry=transform_5, Transform=item_2.Item1)
_2d_publictransportpoints = RemoteSender(transform_6)

transform_7 = RemoteReceiver(transform)
item_3 = ListItem(List=transform_7, Index=0, Wrap=True)  # -> Item, Item1
transform_8 = Transform(Geometry=datavis_it_7.Polyline, Transform=item_3.Item)
transform_9 = Transform(Geometry=transform_8, Transform=item_3.Item1)
_2d_publictransportlines = RemoteSender(transform_9)

transform_10 = RemoteReceiver(transform)
transform_11 = Transform(Geometry=datavis_it_2.Polygon, Transform=transform_10)
item_4 = ListItem(List=transform_11, Index=0, Wrap=True)
_2d_buildings = RemoteSender(item_4)
boundary = BoundarySurfaces(Edges=item_4)

transform_12 = RemoteReceiver(transform)
geo = Geometry(scale_nu.Geometry)
transform_13 = Transform(Geometry=geo, Transform=transform_12)
clean = CleanTree(RemoveNulls=True, RemoveInvalid=True, RemoveEmpty=False, Tree=transform_13)
_2d_contours = RemoteSender(clean)

_2d_contours_2 = RemoteReceiver(_2d_contours)
Z = UnitZ(Factor=datavis_it_3.AttValues)
move = Move(Geometry=_2d_contours_2, Motion=Z)  # -> Geometry, Transform
geo_2 = Geometry(move.Geometry)
divlength = DivideLength(Curve=geo_2, Length=Slider(2, range=0..10))  # -> Points, Tangents, Parameters

scale_nu_2 = ScaleNU(Geometry=datavis_it_4.Polyline, Plane=PlaneXY(0, 0, 0), ScaleX=scale_3, ScaleY=scale_3, ScaleZ=1)  # -> Geometry, Transform

transform_14 = RemoteReceiver(transform)
transform_15 = Transform(Geometry=scale_nu_2.Geometry, Transform=transform_14)
roads = RemoteSender(transform_15)
_2d_roads = RemoteSender(transform_15)

scale_nu_3 = ScaleNU(Geometry=datavis_it_5.Polygon, Plane=PlaneXY(0, 0, 0), ScaleX=scale_4, ScaleY=scale_4, ScaleZ=1)  # -> Geometry, Transform

transform_16 = RemoteReceiver(transform)
transform_17 = Transform(Geometry=scale_nu_3.Geometry, Transform=transform_16)
item_5 = ListItem(List=transform_17, Index=0, Wrap=True)  # -> flatten(Item)
cadastre = RemoteSender(item_5)

# ---- group: Group by type
item_6 = ListItem(List=datavis_it_5.AttValues, Index=python.a, Wrap=True)  # -> flatten(Item)
cset = CreateSet(List=item_6)  # -> Set, Map
tree = CreateTree(Data=item_5, Path=cset.Map)
cadastre_dtree = RemoteSender(tree)
cadastre_type = RemoteSender(cset.Set)

# ---- group: Align corner height
pt_3 = Point(graft(pt_2))
pt_4 = Point(flatten(divlength.Points))
cp = ClosestPoint(Point=pt_3, Cloud=pt_4)  # -> ClosestPoint, CPIndex, Distance
ln = Line(StartPoint=pt_3, EndPoint=cp.ClosestPoint)
pdecon_2 = Deconstruct(Point=cp.ClosestPoint)  # -> XComponent, YComponent, ZComponent
Z_2 = UnitZ(Factor=pdecon_2.ZComponent)
move_2 = Move(Geometry=pt_3, Motion=Z_2)  # -> flatten(Geometry), Transform
pt_5 = Point(move_2.Geometry)

# ----
panel_10 = Panel(cadastre_type)

srf = Surface(boundary)
clean_2 = CleanParallel(PrimaryData=srf, SecondaryData1=merge)  # -> PrimaryData, SecondaryData1
Z_3 = UnitZ(Factor=clean_2.SecondaryData1)
extr = Extrude(Base=clean_2.PrimaryData, Direction=Z_3)

cadastre_dtree_2 = RemoteReceiver(cadastre_dtree)
cadastre_type_2 = RemoteReceiver(cadastre_type)
tmatch_11 = MatchText(Text=cadastre_type_2, Pattern="*ROAD*", Case=True)
group = Group(Objects=cadastre_dtree_2)
dispatch_11 = Dispatch(List=flatten(group), DispatchPattern=tmatch_11)  # -> ListA, ListB
ungroup = Ungroup(Group=dispatch_11.ListA)
ungroup_2 = Ungroup(Group=dispatch_11.ListB)
_2d_cadastre_roads = RemoteSender(ungroup)
_2d_cadastre = RemoteSender(ungroup_2)

Z_4 = UnitZ(Factor=merge)
srf_2 = Surface(boundary)
move_3 = Move(Geometry=srf_2, Motion=Z_4)  # -> Geometry, Transform

merge_2 = Merge(Data1=divlength.Points, Data2=pt_5)
del = DelaunayMesh(Points=flatten(merge_2), Plane=PlaneXY(0, 0, 0))

mesh = Mesh(del)
demesh = DeconstructMesh(Mesh=mesh)  # -> Vertices, Faces, Colours, Normals
lng_9 = ListLength(List=demesh.Faces)
subtraction = Subtraction(A=lng_9, B=1)
redumsh = ReduceMesh(Mesh=mesh, FaceCount=subtraction, Accuracy=1, FaceType=0, Distort=True, Normalize=False)  # -> Reduced, CountDifference
mesh_2 = Mesh(redumsh.Reduced)
topmesh = RemoteSender(mesh_2)

area = Area(Geometry=boundary)  # -> Area, Centroid
pt_6 = Point(area.Centroid)
pt_7 = Point(area.Centroid)
pt_8 = Point(area.Centroid)
topmesh_2 = RemoteReceiver(topmesh)
Z_5 = UnitZ(Factor=1)
meshcp = MeshClosestPoint(Point=pt_8, Mesh=topmesh_2)  # -> Point, Index, Parameter
project = ProjectPoint(Point=pt_7, Direction=Z_5, Geometry=topmesh_2)  # -> Point, Index
dist = Distance(PointA=project.Point, PointB=pt_6)
buildingpointsonmesh = RemoteSender(meshcp.Point)
nullrep = ReplaceNulls(Items=dist, Replacements="0")  # -> Items, Count

subtraction_2 = Subtraction(A=nullrep.Items, B="0.3")
Z_6 = UnitZ(Factor=subtraction_2)
move_4 = Move(Geometry=extr, Motion=Z_6)  # -> Geometry, Transform
buildings = RemoteSender(move_4.Geometry)

subtraction_3 = Subtraction(A=subtraction_2, B="-0.1")
Z_7 = UnitZ(Factor=subtraction_3)
move_5 = Move(Geometry=move_3.Geometry, Motion=Z_7)  # -> Geometry, Transform
roofs = RemoteSender(move_5.Geometry)

roads_2 = RemoteReceiver(roads)  # disabled
topmesh_3 = RemoteReceiver(topmesh)  # disabled
pullcurvetomesh = CSharpScript(M=topmesh_3, C=roads_2)  # -> out, A; inputs M: Mesh, C: list of Curve; disabled
# ---------- pullcurvetomesh: C# ----------
    List<Curve> curveList = new List<Curve>();
    foreach(Curve c in C)
    {
      curveList.Add(c.PullToMesh(M, 0.01));
    }

    A = curveList;
# ---------- end pullcurvetomesh ----------
join = JoinCurves(Curves=flatten(pullcurvetomesh.A), Preserve=False)  # disabled
mesh_3 = Mesh(topmesh_3)  # disabled
crv = Curve(join)  # disabled

panel_11 = Panel("2D::PublicTransport::Lines")  # disabled
_2d_publictransportlines_2 = RemoteReceiver(_2d_publictransportlines)  # disabled
swatch = ColourSwatch(SwatchColor=RGB(48, 171, 48))  # disabled
layers = CreateModifyLayers(LayerName=panel_11, LayerColor=swatch, DeleteLayer=False, enableFullPath=True)  # -> LayerNames, LayerFullPath; disabled
clean_3 = CleanTree(RemoveNulls=True, RemoveInvalid=True, RemoveEmpty=False, Tree=flatten(_2d_publictransportlines_2))  # disabled
createatts = CreateAttributes(Name=panel_11, LayerName=layers.LayerFullPath, enableFullPath=True)  # disabled
bake_all_2 = RemoteReceiver(bake_all)  # disabled
bake = BakeGeometry(Bake=bake_all_2, Geometry=flatten(clean_3), Attributes=createatts, DeleteOldBakes=False, PreserveTrees=False)  # disabled

panel_12 = Panel("2D::PublicTransport::Points")  # disabled
_2d_publictransportpoints_2 = RemoteReceiver(_2d_publictransportpoints)  # disabled
swatch_2 = ColourSwatch(SwatchColor=RGB(76, 230, 89))  # disabled
layers_2 = CreateModifyLayers(LayerName=panel_12, LayerColor=swatch_2, DeleteLayer=False, enableFullPath=True)  # -> LayerNames, LayerFullPath; disabled
clean_4 = CleanTree(RemoveNulls=True, RemoveInvalid=True, RemoveEmpty=False, Tree=flatten(_2d_publictransportpoints_2))  # disabled
createatts_2 = CreateAttributes(Name=panel_12, LayerName=layers_2.LayerFullPath, enableFullPath=True)  # disabled
bake_all_3 = RemoteReceiver(bake_all)  # disabled
bake_2 = BakeGeometry(Bake=bake_all_3, Geometry=flatten(clean_4), Attributes=createatts_2, DeleteOldBakes=False, PreserveTrees=False)  # disabled

panel_13 = Panel("2D::Buildings")  # disabled
_2d_buildings_2 = RemoteReceiver(_2d_buildings)  # disabled
swatch_3 = ColourSwatch(SwatchColor=RGB(0, 0, 214))  # disabled
layers_3 = CreateModifyLayers(LayerName=panel_13, LayerColor=swatch_3, DeleteLayer=False, enableFullPath=True)  # -> LayerNames, LayerFullPath; disabled
clean_5 = CleanTree(RemoveNulls=True, RemoveInvalid=True, RemoveEmpty=False, Tree=flatten(_2d_buildings_2))  # disabled
createatts_3 = CreateAttributes(Name=panel_13, LayerName=layers_3.LayerFullPath, enableFullPath=True)  # disabled
bake_all_4 = RemoteReceiver(bake_all)  # disabled
bake_3 = BakeGeometry(Bake=bake_all_4, Geometry=flatten(clean_5), Attributes=createatts_3, DeleteOldBakes=False, PreserveTrees=False)  # disabled

panel_14 = Panel("2D::Roads")  # disabled
swatch_4 = ColourSwatch(SwatchColor=RGB(255, 0, 0))  # disabled
_2d_roads_2 = RemoteReceiver(_2d_roads)  # disabled
layers_4 = CreateModifyLayers(LayerName=panel_14, LayerColor=swatch_4, DeleteLayer=False, enableFullPath=True)  # -> LayerNames, LayerFullPath; disabled
clean_6 = CleanTree(RemoveNulls=True, RemoveInvalid=True, RemoveEmpty=False, Tree=flatten(_2d_roads_2))  # disabled
createatts_4 = CreateAttributes(Name=panel_14, LayerName=layers_4.LayerFullPath, enableFullPath=True)  # disabled
bake_all_5 = RemoteReceiver(bake_all)  # disabled
bake_4 = BakeGeometry(Bake=bake_all_5, Geometry=flatten(clean_6), Attributes=createatts_4, DeleteOldBakes=False, PreserveTrees=False)  # disabled

_2d_cadastre_roads_2 = RemoteReceiver(_2d_cadastre_roads)  # disabled
panel_15 = Panel("2D::Cadastre_Roads")  # disabled
swatch_5 = ColourSwatch(SwatchColor=RGB(194, 126, 126))  # disabled
layers_5 = CreateModifyLayers(LayerName=panel_15, LayerColor=swatch_5, DeleteLayer=False, enableFullPath=True)  # -> LayerNames, LayerFullPath; disabled
clean_7 = CleanTree(RemoveNulls=True, RemoveInvalid=True, RemoveEmpty=False, Tree=flatten(_2d_cadastre_roads_2))  # disabled
createatts_5 = CreateAttributes(Name=panel_15, LayerName=layers_5.LayerFullPath, enableFullPath=True)  # disabled
bake_all_6 = RemoteReceiver(bake_all)  # disabled
bake_5 = BakeGeometry(Bake=bake_all_6, Geometry=flatten(clean_7), Attributes=createatts_5, DeleteOldBakes=False, PreserveTrees=False)  # disabled

panel_16 = Panel("2D::Cadastre")  # disabled
swatch_6 = ColourSwatch(SwatchColor=RGB(255, 196, 0))  # disabled
_2d_cadastre_2 = RemoteReceiver(_2d_cadastre)  # disabled
layers_6 = CreateModifyLayers(LayerName=panel_16, LayerColor=swatch_6, DeleteLayer=False, enableFullPath=True)  # -> LayerNames, LayerFullPath; disabled
clean_8 = CleanTree(RemoveNulls=True, RemoveInvalid=True, RemoveEmpty=False, Tree=flatten(_2d_cadastre_2))  # disabled
createatts_6 = CreateAttributes(Name=panel_16, LayerName=layers_6.LayerFullPath, enableFullPath=True)  # disabled
bake_all_7 = RemoteReceiver(bake_all)  # disabled
bake_6 = BakeGeometry(Bake=bake_all_7, Geometry=flatten(clean_8), Attributes=createatts_6, DeleteOldBakes=False, PreserveTrees=False)  # disabled

panel_17 = Panel("2D::Topography")  # disabled
swatch_7 = ColourSwatch(SwatchColor=RGB(181, 213, 255))  # disabled
_2d_contours_3 = RemoteReceiver(_2d_contours)  # disabled
layers_7 = CreateModifyLayers(LayerName=panel_17, LayerColor=swatch_7, DeleteLayer=False, enableFullPath=True)  # -> LayerNames, LayerFullPath; disabled
clean_9 = CleanTree(RemoveNulls=True, RemoveInvalid=True, RemoveEmpty=False, Tree=flatten(_2d_contours_3))  # disabled
createatts_7 = CreateAttributes(Name=panel_17, LayerName=layers_7.LayerFullPath, enableFullPath=True)  # disabled
bake_all_8 = RemoteReceiver(bake_all)  # disabled
bake_7 = BakeGeometry(Bake=bake_all_8, Geometry=flatten(clean_9), Attributes=createatts_7, DeleteOldBakes=False, PreserveTrees=False)  # disabled

panel_18 = Panel("3D::Buildings::Roofs")  # disabled
swatch_8 = ColourSwatch(SwatchColor=RGB(121, 247, 182))  # disabled
roofs_2 = RemoteReceiver(roofs)  # disabled
layers_8 = CreateModifyLayers(LayerName=panel_18, LayerColor=swatch_8, DeleteLayer=False, enableFullPath=True)  # -> LayerNames, LayerFullPath; disabled
clean_10 = CleanTree(RemoveNulls=True, RemoveInvalid=True, RemoveEmpty=False, Tree=flatten(roofs_2))  # disabled
createatts_8 = CreateAttributes(Name=panel_18, LayerName=layers_8.LayerFullPath, enableFullPath=True)  # disabled
bake_all_9 = RemoteReceiver(bake_all)  # disabled
bake_8 = BakeGeometry(Bake=bake_all_9, Geometry=flatten(clean_10), Attributes=createatts_8, DeleteOldBakes=False, PreserveTrees=False)  # disabled

swatch_9 = ColourSwatch(SwatchColor=RGB(255, 0, 0))  # disabled
panel_19 = Panel("3D::Roads")  # disabled
crv_2 = Curve(crv)  # disabled
layers_9 = CreateModifyLayers(LayerName=panel_19, LayerColor=swatch_9, DeleteLayer=False, enableFullPath=True)  # -> LayerNames, LayerFullPath; disabled
clean_11 = CleanTree(RemoveNulls=True, RemoveInvalid=True, RemoveEmpty=False, Tree=flatten(crv_2))  # disabled
createatts_9 = CreateAttributes(Name=panel_19, LayerName=layers_9.LayerFullPath, enableFullPath=True)  # disabled
bake_all_10 = RemoteReceiver(bake_all)  # disabled
bake_9 = BakeGeometry(Bake=bake_all_10, Geometry=flatten(clean_11), Attributes=createatts_9, DeleteOldBakes=False, PreserveTrees=False)  # disabled

swatch_10 = ColourSwatch(SwatchColor=RGB(107, 161, 232))  # disabled
panel_20 = Panel("3D::Topography")  # disabled
geo_3 = Geometry(mesh_3)  # disabled
layers_10 = CreateModifyLayers(LayerName=panel_20, LayerColor=swatch_10, DeleteLayer=False, enableFullPath=True)  # -> LayerNames, LayerFullPath; disabled
clean_12 = CleanTree(RemoveNulls=True, RemoveInvalid=True, RemoveEmpty=False, Tree=flatten(geo_3))  # disabled
createatts_10 = CreateAttributes(Name=panel_20, LayerName=layers_10.LayerFullPath, enableFullPath=True)  # disabled
bake_all_11 = RemoteReceiver(bake_all)  # disabled
bake_10 = BakeGeometry(Bake=bake_all_11, Geometry=flatten(clean_12), Attributes=createatts_10, DeleteOldBakes=False, PreserveTrees=False)  # disabled

panel_21 = Panel("3D::Buildings::Masses")  # disabled
buildings_2 = RemoteReceiver(buildings)  # disabled
swatch_11 = ColourSwatch(SwatchColor=RGB(0, 214, 104))  # disabled
layers_11 = CreateModifyLayers(LayerName=panel_21, LayerColor=swatch_11, DeleteLayer=False, enableFullPath=True)  # -> LayerNames, LayerFullPath; disabled
clean_13 = CleanTree(RemoveNulls=True, RemoveInvalid=True, RemoveEmpty=False, Tree=flatten(buildings_2))  # disabled
createatts_11 = CreateAttributes(Name=panel_21, LayerName=layers_11.LayerFullPath, enableFullPath=True)  # disabled
bake_all_12 = RemoteReceiver(bake_all)  # disabled
bake_11 = BakeGeometry(Bake=bake_all_12, Geometry=flatten(clean_13), Attributes=createatts_11, DeleteOldBakes=False, PreserveTrees=False)  # disabled
